# Grasshopper definition autonest_v2.gh (Grasshopper 1.0.8)
# plug-ins: opennest_2 Info

cut = Curve([<curve referenced from the Rhino model> x12])
from = Slider(1, range=0..1000)
count = Slider(50, range=1..500)
minutes = Slider(0, range=0..120)
curve = Curve(<curve referenced from the Rhino model>)
run = BooleanToggle(False)
tol_cm = Panel("1")
bake = Button()
graft = GraftTree(Tree=cut, IncludeEmptyLists=True, IncludeNullItems=True)
curve_2 = Curve(flatten(graft))
opennest1 = OpenNest1(
    Sheets=curve,
    Geo=curve_2,
    Spacing="0",
    Placement=Slider(3, range=0..3),
    Tolerance=0.1,
    Rotations=Slider(4, range=1..4),
    Iterations=Slider(310, range=0..1000),
    Seed=Slider(29, range=1..100),
    Reset=Button(),
    Run=Toggle(True))  # -> Sheets, Geo, ID, Transform, IDS
seedsearch = GhPythonScript(Geo=opennest1.Geo, Run=run, From=from, Count=count, Minutes=minutes, Tol=tol_cm)  # -> out, Seed, L, A, Table; inputs Geo: tree
# ---------- seedsearch: Python ----------
# -*- coding: utf-8 -*-
"""SeedSearch — GhPython component for autonest_v2.gh.

Tries OpenNest2 seeds one after another and keeps the layout that takes the
least material along X; among the shortest (within Tol) — the smallest
bounding box area. OpenNest2 runs its generations over many solutions, so
Galapagos can't score it; this component waits for each result ("fit …").
A panel that doesn't fit OpenNest puts on an extra copy of the sheet (IDS ≥
number of sheets): such a layout is missing panels and never wins over one
with all of them; its length counts only the panels on the real sheet.

Inputs:
    Geo     : Geo output of OpenNest, Tree access (only to be solved when it changes;
              the layout is read from OpenNest itself)
    Run     : Boolean Toggle — True starts a new search, False stops it
    From    : first seed (default 1)
    Count   : how many seeds (default 50)
    Minutes : time limit, 0 — none
    Tol     : cm — lengths within Tol count as equally short (default 1)
Outputs:
    Seed    : best seed (set on the Seed slider at the end)
    L       : its length along X, cm
    A       : its bounding box area, m²
    Table   : "seed  L cm  A m²  [missing n]" per tried seed, best first
"""


def pick(results, tol):
    """(seed, length, area, missing) list → best one: fewest missing panels, then shortest within tol, then least area."""
    if not results:
        return None
    least = min(r[3] for r in results)
    full = [r for r in results if r[3] == least]
    short = min(r[1] for r in full)
    return min((r for r in full if r[1] <= short + tol), key=lambda r: (r[2], r[1]))


def table(results, tol):
    best = pick(results, tol)
    rows = sorted(results, key=lambda r: (r[3], r[1], r[2]))
    rows.remove(best)
    return ["%d  %.1f cm  %.3f m2" % r[:3] + ("  missing %d" % r[3] if r[3] else "") for r in [best] + rows]


if "ghenv" in globals():
    import time
    import System
    import Rhino
    import scriptcontext as sc
    import Grasshopper

    comp = ghenv.Component
    gd = comp.OnPingDocument()
    st = sc.sticky.setdefault("SeedSearch.%s" % comp.InstanceGuid, {"on": False, "run": False, "seeds": [], "results": []})
    From = 1 if From is None else int(From)
    Count = int(Count or 50)
    Minutes = float(Minutes or 0)
    Tol = 1.0 if Tol is None else float(Tol)
    cm = Rhino.RhinoMath.UnitScale(Rhino.RhinoDoc.ActiveDoc.ModelUnitSystem, Rhino.UnitSystem.Centimeters)

    nest = next((o for o in (s.Attributes.GetTopLevel.DocObject for s in comp.Params.Input[0].Sources)
                 if o.GetType().FullName.endswith("component_nest1")), None)
    inp = dict((p.Name, p) for p in nest.Params.Input) if nest else {}
    slider = inp["Seed"].Sources[0] if nest and inp["Seed"].Sources else None
    if not isinstance(slider, Grasshopper.Kernel.Special.GH_NumberSlider):
        comp.AddRuntimeMessage(Grasshopper.Kernel.GH_RuntimeMessageLevel.Error,
                               "Geo must come from OpenNest, its Seed from a Number Slider")
    else:
        def measure():
            """(length, area, missing panels) of the finished layout in cm / m², None while OpenNest is busy."""
            if not (nest.Message or "").startswith("fit"):
                return None
            geo, sheet_of = nest.Params.Output[1].VolatileData, nest.Params.Output[4].VolatileData
            sheets = list(inp["Sheets"].VolatileData.AllData(True))
            box = Rhino.Geometry.BoundingBox.Empty
            placed = 0
            for i in range(min(geo.PathCount, sheet_of.PathCount)):
                if geo.Branches[i].Count and sheet_of.Branches[i].Count and sheet_of.Branches[i][0].Value < len(sheets):
                    placed += 1
                    for g in geo.Branches[i]:
                        box.Union(g.Boundingbox)
            if not box.IsValid:
                return None
            x0 = min(g.Boundingbox.Min.X for g in sheets)
            length = (box.Max.X - x0) * cm
            # one curve per part (the Cut list grafted)
            return length, length * (box.Max.Y - box.Min.Y) * cm / 1e4, inp["Geo"].VolatileDataCount - placed

        def set_seed(value):
            """Seed on the slider at the next solution; the result on screen is not its own until OpenNest restarts."""
            st["fresh"] = False
            def cb(doc):
                v = System.Decimal(value)
                slider.Slider.Maximum = max(slider.Slider.Maximum, v)
                slider.Slider.Minimum = min(slider.Slider.Minimum, v)
                slider.SetSliderValue(v)
                slider.ExpireSolution(False)
            gd.ScheduleSolution(5, Grasshopper.Kernel.GH_Document.GH_ScheduleDelegate(cb))

        def stop():
            st["run"] = False
            if st["results"]:
                set_seed(pick(st["results"], Tol)[0])

        if Run and not st["on"]:
            st.update(run=True, seeds=list(range(From, From + Count)), results=[], t0=time.time())
            if int(slider.CurrentValue) == From:
                st["fresh"] = True
            else:
                set_seed(From)
        elif not Run and st["on"] and st["run"]:
            stop()
        st["on"] = bool(Run)

        # ponytail: no per-seed timeout — if OpenNest never prints "fit" the search waits; Run off stops it
        if st["run"] and int(slider.CurrentValue) == st["seeds"][0]:
            done = measure()
            if done is None:
                st["fresh"] = True
            elif st["fresh"]:
                st["results"].append((st["seeds"].pop(0),) + done)
                if st["seeds"] and not (Minutes and time.time() - st["t0"] > Minutes * 60):
                    set_seed(st["seeds"][0])
                else:
                    stop()

        n = len(st["results"])
        if n:
            Seed, L, A, missing = pick(st["results"], Tol)
            Table = table(st["results"], Tol)
            if missing:
                comp.AddRuntimeMessage(Grasshopper.Kernel.GH_RuntimeMessageLevel.Warning,
                                       "every seed so far leaves %d panel(s) off the sheet" % missing)
        comp.Message = ("%s %d/%d" % ("seed" if st["run"] else "done", n, n + len(st["seeds"])) if st["seeds"] or n
                        else "Run = True") + ("  best %d" % Seed if n else "")


if __name__ == "__main__" and "ghenv" not in globals():
    r = [(1, 1500.0, 30.0, 0), (2, 1439.2, 29.8, 0), (3, 1439.9, 28.0, 0), (4, 1441.0, 20.0, 0), (5, 900.0, 15.0, 1)]
    assert pick(r, 1.0)[0] == 3       # 1439.9 within 1 cm of the shortest, smaller area
    assert pick(r, 0.5)[0] == 2       # only the shortest
    assert pick(r, 2.0)[0] == 4
    assert pick([], 1.0) is None
    assert table(r, 1.0)[0].startswith("3 ")
    assert table(r, 1.0)[-1] == "5  900.0 cm  15.000 m2  missing 1"   # shorter, but a panel short — last
    assert pick([(5, 900.0, 15.0, 2), (6, 950.0, 15.0, 1)], 1.0)[0] == 6
    print("ok")
# ---------- end seedsearch ----------
curve_3 = Curve(flatten(opennest1.Geo))
seeds = Panel(seedsearch.Table)
carryinside = GhPythonScript(Cut=cut, X=opennest1.Transform, Bake=bake)  # -> out, CUT, INK, INT, Other, N; inputs Cut: tree, X: tree
# ---------- carryinside: Python ----------
# -*- coding: utf-8 -*-
"""CarryInside — GhPython component for autonest_v2.gh.

Everything that lies inside each Cut (INK, INT, texts, points, holes — any
visible object of the Rhino document, any layer) goes with the Cut to its
nested place: the Cut's own OpenNest transform is applied to a copy.

An object belongs to a Cut when its start, middle or end (point / text:
its centre) is inside the Cut or on its line; inside several Cuts — the
smallest one. Objects inside no Cut stay where they are.

A Cut that doesn't fit OpenNest puts on an extra copy of the sheet (IDS ≥
number of sheets): it is left out with a warning, the message counts the
placed ones ("11/12 placed").

Inputs:
    Cut  : the Cut curves referenced from Rhino — the same list OpenNest
           nests (Tree access)
    X    : Transform output of OpenNest (Tree access)
    Bake : Button — copies (Cut + everything inside) added to the Rhino
           document with their own layer / colour / linetype, one group per
           part, one undo
Outputs (one per layer, to bake each into its layer; branch {i} = Cut i):
    CUT   : moved Cut copies
    INK   : moved copies from layer INK
    INT   : moved copies from layer INT
    Other : moved copies from any other layer
    N     : "<cut>: <objects inside>" per Cut
"""


def find_nest(param):
    """OpenNest that feeds param, through relays."""
    for s in param.Sources:
        o = s.Attributes.GetTopLevel.DocObject
        if o.GetType().FullName.endswith("component_nest1"):
            return o
        if hasattr(o, "Sources"):
            o = find_nest(o)
            if o:
                return o
    return None


def owner(hits, areas):
    """Index of the Cut an object belongs to: the smallest Cut holding one of its points."""
    return min(hits, key=lambda i: areas[i]) if hits else None


if "ghenv" in globals():
    import Rhino
    import Rhino.Geometry as rg
    import Grasshopper
    from Grasshopper import DataTree
    from Grasshopper.Kernel.Data import GH_Path

    LAYERS = ["CUT", "INK", "INT", "Other"]
    comp = ghenv.Component
    rdoc = Rhino.RhinoDoc.ActiveDoc
    tol = rdoc.ModelAbsoluteTolerance
    cuts = [rdoc.Objects.FindId(g.ReferenceID) for g in comp.Params.Input[0].VolatileData.AllData(True)]
    xdata = comp.Params.Input[1].VolatileData
    xforms = [list(xdata.Branches[i]) if i < xdata.PathCount else [] for i in range(len(cuts))]
    nest = find_nest(comp.Params.Input[1])
    off = set()
    if nest:
        sheet_of = nest.Params.Output[4].VolatileData
        sheets = nest.Params.Input[0].VolatileDataCount
        off = set(i for i in range(min(len(cuts), sheet_of.PathCount))
                  if sheet_of.Branches[i].Count and sheet_of.Branches[i][0].Value >= sheets)

    if not cuts or None in cuts:
        comp.AddRuntimeMessage(Grasshopper.Kernel.GH_RuntimeMessageLevel.Error, "Cut must be curves referenced from Rhino")
    elif any(xforms):
        curves = [c.Geometry for c in cuts]
        boxes = [c.GetBoundingBox(True) for c in curves]
        for b in boxes:
            b.Inflate(tol)
        areas = [b.Area for b in boxes]

        def samples(geo):
            if isinstance(geo, rg.Curve):
                return [geo.PointAtStart, geo.PointAt(geo.NormalizedLengthParameter(0.5)[1]), geo.PointAtEnd]
            if isinstance(geo, rg.Point):
                return [geo.Location]
            return [geo.GetBoundingBox(True).Center]

        def holds(i, p):
            return boxes[i].Contains(p) and curves[i].Contains(p, rg.Plane.WorldXY, tol) != rg.PointContainment.Outside

        parts = [[c] for c in cuts]
        skip = set(c.Id for c in cuts)
        settings = Rhino.DocObjects.ObjectEnumeratorSettings()
        settings.HiddenObjects = False
        settings.LockedObjects = True
        settings.VisibleFilter = True
        for obj in rdoc.Objects.GetObjectList(settings):
            if obj.Id not in skip and obj.Attributes.Space == Rhino.DocObjects.ActiveSpace.ModelSpace:
                i = owner(set(i for p in samples(obj.Geometry) for i in range(len(cuts)) if holds(i, p)), areas)
                if i is not None:
                    parts[i].append(obj)

        out = dict((k, DataTree[object]()) for k in LAYERS)
        N = ["%d: %d" % (i, len(part) - 1) for i, part in enumerate(parts)]
        placed = inside = 0
        if Bake:
            rec = rdoc.BeginUndoRecord("CarryInside bake")
        for i, part in enumerate(parts):
            if len(xforms[i]) != 1 or i in off:
                comp.AddRuntimeMessage(Grasshopper.Kernel.GH_RuntimeMessageLevel.Warning,
                                       "Cut %d didn't fit the sheet — left out" % i)
                continue
            placed += 1
            inside += len(part) - 1
            group = rdoc.Groups.Add() if Bake else None
            for obj in part:
                g = obj.Geometry.Duplicate()
                g.Transform(xforms[i][0].Value)
                top = rdoc.Layers[obj.Attributes.LayerIndex].FullPath.split("::")[0].upper()
                out[top if top in LAYERS else "Other"].Add(g, GH_Path(i))
                if Bake:
                    a = obj.Attributes.Duplicate()
                    a.RemoveFromAllGroups()
                    a.AddToGroup(group)
                    rdoc.Objects.Add(g, a)
        if Bake:
            rdoc.EndUndoRecord(rec)
            rdoc.Views.Redraw()
        CUT, INK, INT, Other = [out[k] for k in LAYERS]
        comp.Message = "%d/%d placed, %d inside" % (placed, len(cuts), inside)


if __name__ == "__main__" and "ghenv" not in globals():
    assert owner(set(), [1.0]) is None
    assert owner({0, 2}, [5.0, 1.0, 2.0]) == 2      # nested: the smaller Cut wins
    assert owner({1}, [5.0, 1.0]) == 1

    class P(object):                         # find_nest through a relay
        def __init__(self, name, sources=()):
            self.Sources = list(sources)
            self.Attributes = self
            self.GetTopLevel = self
            self.DocObject = self
            self.name = name
        def GetType(self):
            return self
        @property
        def FullName(self):
            return self.name
    nest = P("opennest_2.component_nest1")
    assert find_nest(P("x", [P("Relay", [nest])])) is nest
    assert find_nest(P("x", [P("Relay")])) is None
    print("ok")
# ---------- end carryinside ----------
geometry = Geometry(curve_3)
